# Grasshopper definition VeronoiSurface.gh (Grasshopper 1.0.7)
# plug-ins: Bifocals

surface = Surface(<surface referenced from the Rhino model>)
dimensions = Dimensions(Surface=surface)  # -> UDimension, VDimension
curve = Curve(<curve referenced from the Rhino model>)
mesh = Mesh(curve)
plane_surface = PlaneSurface(Plane=PlaneXY(0, 0, 0), XSize=dimensions.UDimension, YSize=dimensions.VDimension)
populate_geometry = PopulateGeometry(Geometry=mesh, Count=Slider(100, range=0..100), Seed=1)
populate_geometry_2 = PopulateGeometry(Geometry=plane_surface, Count=Slider(186, range=0..200), Seed=1)
curve_2 = Curve(plane_surface)
voronoi = Voronoi(Points=populate_geometry, BruteForceOverride=False)
voronoi_2 = Voronoi(Points=populate_geometry_2, Boundary=curve_2, BruteForceOverride=False)
area = Area(Geometry=voronoi_2)  # -> Area, Centroid
scale = Scale(Geometry=voronoi, Center=populate_geometry, Factor=Slider(0.63, range=0..1))  # -> Geometry, Transform
scale_2 = Scale(Geometry=voronoi_2, Center=area.Centroid, Factor=Slider(0.81, range=0..1))  # -> Geometry, Transform
region_intersection = RegionIntersection(CurvesA=scale.Geometry, CurvesB=curve)
curve_3 = Curve(flatten([curve_2, scale_2.Geometry]))
curve_4 = Curve(flatten([region_intersection, curve]))
boundary_surfaces = BoundarySurfaces(Edges=curve_3)
unit_z = UnitZ(Factor=Slider(6, range=0..10))
boundary_surfaces_2 = BoundarySurfaces(Edges=curve_4)
extrude = Extrude(Base=boundary_surfaces, Direction=unit_z)
unit_z_2 = UnitZ(Factor=Slider(6, range=0..10))
number_slider = Slider(1, range=0..1)
box = Box(extrude)
number_slider_2 = Slider(1, range=0..1)
extrude_2 = Extrude(Base=boundary_surfaces_2, Direction=unit_z_2)
surface_morph = SurfaceMorph(
    Geometry=extrude,
    Reference=box,
    Surface=reparameterize(surface),
    UDomain=number_slider,
    VDomain=number_slider,
    WDomain=number_slider)
